# Grasshopper definition ClosedObjectbff.gh (Grasshopper 1.0.7)
# plug-ins: BoundaryFirstFlatterningMac

bunny = Mesh(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)
simple_open_mesh = Mesh(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)
boundaryfirstflatenning = BoundaryFirstFlatenning(
    Mesh=simple_open_mesh,
    MapToSphere=Slider(0, range=0..2),
    NCones=Slider(0, range=0..20),
    NormalizeUVs=Toggle(True),
    VertexOrder=Toggle(True))  # -> Mesh3D, Mesh2D

# ---- group: Slice the sphere
range = Range(Domain="-1 to 1", Steps=Slider(100, range=0..100))
xy = XYPlane(Origin=Point(0, 0, 0))
contour = ContourEx(Shape=boundaryfirstflatenning.Mesh2D, Plane=xy, Offsets=range)  # -> flatten(Contours)

# ---- group: Change the V input and check the order
demesh = DeconstructMesh(Mesh=boundaryfirstflatenning.Mesh2D)  # -> Vertices, Faces, Colours, Normals
demesh_2 = DeconstructMesh(Mesh=boundaryfirstflatenning.Mesh3D)  # -> Vertices, Faces, Colours, Normals
ln = Line(StartPoint=demesh.Vertices, EndPoint=demesh_2.Vertices)

# ----
crv = Curve(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)
mappolylines = MapPolylines(Curves=crv, Mesh0=boundaryfirstflatenning.Mesh2D, Mesh1=boundaryfirstflatenning.Mesh3D)
preview = CustomPreview(Geometry=mappolylines, Material=ColourSwatch(SwatchColor=RGB(255, 255, 255)))
pline = PolyLine(Closed=False)
